vi "Tab - Selector - Visible.gvi"   [G Web Development Software 22.0.0]
inputs:
  "error in": error
  "reference in": "TabControl reference", required
  "visible?": bool, required
outputs:
  "error out": error
  "reference out": "TabControl reference"
uses:
  ControlExtensions::Support::Obtain JavaScript Reference - GObject.gvi
  ControlExtensions::Support::ControlExtensions.jsli::TabSelectorVisible
diagram:
  $"reference out" <- $"reference in"
  call "Obtain JavaScript Reference - GObject.gvi"(reference in=$"reference in", error in=$"error in") -> (error out=w1, javascript reference out=w2)
  call "TabSelectorVisible"(element=w2, visible=$"visible?", error in=w1) -> (error out=w3)
  Close Reference(error in=w3, reference=w2) -> (error out=w4)
  $"error out" <- w4
